# Grasshopper definition 06_froGH_View-Display.gh (Grasshopper 1.0.7)
# plug-ins: froGH, Weaverbird

# ---- group: a small polyhedra collection
pt = Point(Point(209.3215625, 0, 0))
sqgrid = Square(Plane=pt, Size="30", ExtentX=5, ExtentY=5)  # -> flatten(Cells), Points
lng = ListLength(List=sqgrid.Cells)
random = Random(Range="0 To 5", Number=lng, Seed=3, Integers=True)
random_2 = Random(Range="10 To 25", Number=lng, Seed=2, Integers=False)
pcen = PolygonCenter(Polyline=sqgrid.Cells)  # -> CenterV, CenterE, CenterA
f_ifroml = IndexesFromList(Data=sqgrid.Cells)
wheel = ColourWheel(
    lng,
    ColourGrips_Style=20,
    ColourGrips_Grip=[4.020404268, 0.4732448222, 4.188790205, 3.141592654],
    ColourGrips_Lum=[0.1, 0.5],
    ColourGrips_Range=[0.4571663251, 0.4751886364, 0.2617993878, 0.2617993878],
    ColourGrips_Sat=[0.2, 0.6])
f_sphgen = SpaceFillingPolyhedraGenerator(BasePlane=pcen.CenterV, PolyhedronType=random, Scale=random_2)  # -> Mesh, FacePolylines
Z = UnitZ(Factor="20")
preview = CustomPreview(Geometry=f_sphgen.Mesh, Material=wheel)
move = Move(Geometry=pcen.CenterV, Motion=Z)  # -> Geometry, Transform
tag = TextTag3D(Location=move.Geometry, Text=f_ifroml, Size="5", Colour=ColourSwatch(SwatchColor=RGB(255, 255, 255)), Justification=5)

# ----
# froGH
crv = Curve(reparameterize(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))

# ---- group: a simple rollercoaster
number_slider = Slider(25, range=10..100)
range = Range(Domain=Domain(0, 1), Steps=expr("x-1", number_slider))
pframes = PerpFrames(Curve=crv, Count=number_slider, Align=True)  # -> Frames, Parameters
graph = GraphMapper(range, x0=0, x1=1, y0=0, y1=1, container_name="Bezier", cpx=[0, 0.1734685451, 0.5223627687, 1], cpy=[1, 0, 0, 1])
multiplication = Multiplication(A=Slider(5.24, range=1..10), B=graph)
cir = Circle(Plane=pframes.Frames, Radius=multiplication)
gradient = Gradient(
    LowerLimit=0,
    UpperLimit=1,
    Parameter=range,
    stops=[0: RGB(243, 57, 0), 0.1: RGB(236, 27, 60), 0.2: RGB(210, 0, 118), 0.3: RGB(103, 0, 120), 0.4: RGB(39, 72, 161), 0.5: RGB(1, 192, 229), 0.6: RGB(18, 178, 90), 0.7: RGB(79, 186, 8), 0.8: RGB(220, 237, 32), 0.9: RGB(247, 159, 20), 1: RGB(243, 57, 0)])
pframes_2 = PerpFrames(Curve=cir, Count=Slider(20, range=5..20), Align=True)  # -> Frames, Parameters
polygon = Polygon(Plane=pframes_2.Frames, Radius=Slider(0.5, range=0..1), Segments=6, FilletRadius=0)  # -> Polygon, Length
f_pmloft = PolylinesMeshLoft(Polylines=polygon.Polygon, Closed=Toggle(True))  # -> flatten(Mesh)
preview_2 = CustomPreview(Geometry=f_pmloft, Material=gradient)

# ----
# 1. activate the camera controller component
# 
# 2. change or animate this slider for a rollercoaster ride!
camera_position = Slider(0, range=0..1)
geo = Geometry(f_sphgen.Mesh)
selector = Slider(1, range=0..1)
lng_2 = ListLength(List=geo)  # -> expr("x-1", Length)
subdir_name = Panel("captures\")
pt_2 = Point(Point(178.4813996, 0, 0))
f_ghfilepath = GHFilePathInfo()  # -> FileName, FilePath
multiplication_2 = Multiplication(A=lng_2, B=selector)
cw = BooleanToggle(False)

activate = Button()
f_fro = Froggle(Button=activate)

activate_2 = Button()
f_fro_2 = Froggle(Button=activate_2)

capture = Button()
f_fro_3 = Froggle(Button=capture)

# ----
# froGH - View/Display example file
# 
# Examples for the usage of froGH View/Display components
# 
# code by Alessio Erioli
# 
# v 0.1
# © Co-de-iT 2020 / Creative Commons Attribution-Non Commercial-ShareAlike 4.0 International License
eval = EvaluateCurve(Curve=crv, Parameter=camera_position)  # -> Point, Tangent, Angle
f_sphgen_2 = SpaceFillingPolyhedraGenerator(BasePlane=pt_2, PolyhedronType=0, Scale="30")  # -> Mesh, FacePolylines
concat = Concatenate(FragmentA=f_ghfilepath.FilePath, FragmentB=subdir_name)
zoom = BooleanToggle(True)
lookahead = Slider(5, range=0..5)
item = ListItem(List=geo, Index=multiplication_2, Wrap=True)
refresh = Button()
update = Button()
# save a named view in Rhino or load a file with named views, then hit update.
# 
# The component outputs the data to create corresponding cameras in Cinema4D
update_2 = Button()
crv_2 = Curve(f_sphgen.FacePolylines)
pt_3 = Point(Point(77.91631543, 0, 0))
panel = Panel("Top")
f_camrep = CameraReport(Update=update)  # -> Location, Target, Lens, UpVector, NearClippingPlane, FarClippingPlane
f_nv2c4d = NamedViewsToCinema4D(Update=update_2)
f_o2cam = OrientToCamera(BasePoint=pt_3, Refresh=refresh)
f_vc2f = ViewCaptureToFile(
    FilePath=concat,
    FileName="screencap.png",
    ImageSize="1920x1080",
    Scale=1,
    Grid=False,
    Axes=False,
    Widget=False,
    Capture=f_fro_3)
# 1. Select the viewport name (empty for active viewport) & Display mode (empty for current display mode)
# 
# 2. activate
# 
# 3. use the selector slider and... behold! My incredible polyhedra collection! Inspect them one by one, use Zoom factor to look closer or move away
f_camconz2geo = CameraControlAndZoomToGeometry(
    Geometry=item,
    ViewportName="Top",
    CameraType=-1,
    DisplayMode="Rendered",
    ZoomFactor=Slider(-0.801, range=-2..2),
    Zoom=zoom,
    Activate=f_fro_2)
multiplication_3 = Multiplication(A=eval.Tangent, B=lookahead)
f_tt = Turntable(
    Geometry=f_sphgen_2.Mesh,
    DistanceMultiplier=Slider(1.832, range=1..10),
    LensRange=Domain(21, 120),
    LensInterpolationParameter=Slider(0, range=0..1),
    Direction=cw,
    AdjustStartPoint=Slider(0.25, range=0..1),
    CameraTiltShift=Slider(0, range=-10..10),
    TargetTiltShift=Slider(0, range=-10..10),
    AnimationParameter=Slider(1, range=0..1),
    Activate=f_fro)
move_2 = Move(Geometry=eval.Point, Motion=multiplication_3)  # -> Geometry, Transform
panel_2 = Panel(f_nv2c4d)
panel_3 = Panel(f_camrep.Location)
panel_4 = Panel(f_camrep.Target)
panel_5 = Panel(f_camrep.Lens)
panel_6 = Panel(f_camrep.UpVector)
panel_7 = Panel(f_camrep.NearClippingPlane)
panel_8 = Panel(f_camrep.FarClippingPlane)

activate_3 = Button()
f_fro_4 = Froggle(Button=activate_3)

tag_2 = TextTag3D(
    Location=f_o2cam,
    Text="view-aligned text",
    Size="5",
    Colour=ColourSwatch(SwatchColor=RGB(255, 255, 255)),
    Justification=7)
Z_2 = UnitZ(Factor=1)
f_camconz2geo_2 = CameraControlAndZoomToGeometry(
    CameraType=-1,
    CameraLocation=eval.Point,
    TargetLocation=move_2.Geometry,
    Lens=Slider(21, range=21..120),
    UpVector=Z_2,
    ZoomFactor=0.1,
    Zoom=False,
    Activate=f_fro_4)
number_slider_2 = Slider(20, range=10..50)
pt_4 = Point(Point(418.8982485, 0, 0))
box = CenterBox(Base=pt_4, X=1, Y=1, Z=1)
pt_5 = Point(Point(383.0148735, 0, 0))
f_sphgen_3 = SpaceFillingPolyhedraGenerator(BasePlane=pt_5, PolyhedronType=0, Scale="30")  # -> Mesh, FacePolylines
arrbox = BoxArray(Geometry=pt_4, Cell=box, XCount=number_slider_2, YCount=number_slider_2, ZCount=number_slider_2)  # -> Geometry, Transform
expression = Expression(x=arrbox.Geometry, y=Slider(0.1, range=0..1), Expression="pow(sin(x.X*y),2)*pow(sin(x.Z*y),2)+abs(cos(x.Y*y))")
Y = UnitY(Factor="40")
resolution = ValueList({"Coarse": 0, "Fine": 1, "Extra-Fine": 2, "ARE YOU NUTS??!?": 3}, selected="Extra-Fine")
move_3 = Move(Geometry=f_sphgen_3.Mesh, Motion=Y)  # -> Geometry, Transform
my_slider = Slider(0.406, range=0..1)
integers = Slider(6, range=0..10)
values_a = Slider(3504.998, range=10..5000)
values_b = Slider(2868.99, range=10..8000)
pt_6 = Point(Point(477.3550096, 0, 0))
wbcatmullclark = WeaverbirdsCatmullClarkSubdivision(MeshCurves=move_3.Geometry, Level=Slider(3, range=1..3), SmoothNakedEdges=1)
xy = XYPlane(Origin=pt_6)
gradient_2 = Gradient(
    LowerLimit=0,
    UpperLimit=1,
    Parameter=expression,
    stops=[0: RGB(234, 38, 0), 0.25: RGB(234, 126, 0), 0.5: RGB(254, 244, 84), 0.75: RGB(173, 203, 249), 1: RGB(75, 107, 169)])
fresnel = BooleanToggle(True)
reflection = ColourSwatch(SwatchColor=RGB(255, 255, 255))
mesh = Mesh(flatten([f_sphgen_3.Mesh, wbcatmullclark]))
emission = ColourSwatch(SwatchColor=RGB(0, 0, 0))
ambient = ColourSwatch(SwatchColor=RGB(0, 0, 0))
diffuse = ColourSwatch(SwatchColor=RGB(0, 0, 0))
pt_7 = Point([Point(515.8169472, 0, 0), Point(517.8169472, 0, 0), Point(519.8169472, 0, 0), Point(521.8169472, 0, 0), Point(523.8169472, 0, 0), Point(525.8169472, 0, 0)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])
num = Number([0.3204408902, 0.316437984, 0.3153849387, 0.3167303972, 0.3192082361, 0.3055316069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])
f_matc = CustomMaterial(
    DiffuseColor=diffuse,
    AmbientColor=ambient,
    EmissionColor=emission,
    ReflectionColor=reflection,
    Reflectivity=Slider(1, range=0..1),
    ReflectionGlossiness=Slider(0.25, range=0..1),
    RefractionGlossiness=Slider(0, range=0..1),
    FresnelReflections=fresnel,
    IndexOfRefraction=Slider(1.2, range=1..2),
    Transparency=Slider(0, range=0..1))
# Use the Zoomable interface to add sliders input channels (1 slider per channel). Empty channels create spacers.
f_slvdisp = SliderValueDisplay(
    OrientationPlane=xy,
    SliderLength=Slider(20, range=10..100),
    TextFont="Arial",
    TextSize=Slider(0.5, range=0..2),
    BaseColor=ColourSwatch(SwatchColor=RGB(224, 224, 224)),
    HighlightColor=ColourSwatch(SwatchColor=RGB(0, 0, 0)),
    S0=my_slider,
    S1=integers,
    S3=values_a,
    S4=values_b)
f_cmvd = CustomMeshVerticesDisplay(Mesh=mesh, Color=ColourSwatch(SwatchColor=RGB(255, 255, 255)), Width=Slider(2, range=1..5))
f_wscd = WeightedSpheresCloudDisplay(Points=pt_7, Radius=num, Resolution=resolution)
f_cmwd = CustomMeshWiresDisplay(Mesh=mesh, Color=ColourSwatch(SwatchColor=RGB(103, 135, 194)), Width=Slider(2, range=1..5))
# or just plug a single color
f_pcd = PointCloudDisplay(Points=arrbox.Geometry, Colors=gradient_2, Size=Slider(3, range=1..5))
preview_3 = CustomPreview(Geometry=mesh, Material=f_matc)
